# Grasshopper definition Isovist_Weimar.gh (Grasshopper 0.9.76)
# plug-ins: DeCodingSpaces

obstacle_curves = Curve([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])
# IMPORTANT NOTE!
# 
# All the necessary inputs for this example are already embedded in this scrip.
# If the geometry doesn’t show up in your rhino, pleas select the grasshopper component containing the geometry, right click on grasshopper canvas and select “Zoom”
isovist_center = Point(Point(8326.499671, 5443.224074, 0))
explode = Explode(Curve=obstacle_curves, Recursive=True)  # -> flatten(Segments), Vertices
isovist = Isovist(
    VantagePointS=isovist_center,
    ObstacleLines=explode.Segments,
    ViewingDirection=Vector(0, 1, 0),
    ViewingRange=1000,
    ViewingAngle=360,
    Precision=360,
    ShowPolygon=Toggle(True),
    ShowRadials=False,
    UseGPU=Toggle(False))  # -> IsovistPolygon, Radials, RadialIntersectionAngles, RealSurfacePerimeterLines, OccludingPerimeterLines, VisibleObstacles, IsovistProperties
value_list = ValueList({"Area": 0, "Area (Dist Weighted)": 1, "Perimeter": 2, "Compactness": 3, "Circularity": 4, "ConvexDeficiency": 5, "Occlusivity": 6, "Min Radial": 7, "Max Radial": 8, "Mean Radial": 9, "Standard Deviation": 10, "Variance": 11, "Skewness": 12, "Dispersion": 13, "Elongation": 14, "Drift Magnitude": 15, "Drift Angle": 16}, selected="Area")
list_item = ListItem(List=isovist.IsovistProperties, Index=value_list, Wrap=True)  # -> flatten(Item)
panel = Panel(list_item)
srf = Surface(isovist.IsovistPolygon)
